# Grasshopper definition MJProcGen.gh (Grasshopper 1.0.8)
# plug-ins: RhinoCodePluginGH

refresh = Button()
panel = Panel("C:\Users\Drew\Desktop\Projects\MJ Proc Gen gh\rulesets\test_ruleset.xml")
initiate_mj_main = CSharpScript(enableDebug=Toggle(True), refresh=refresh)  # -> debug, main
# ---------- initiate_mj_main: C# ----------
// Grasshopper Script Instance
#region Usings
using System;
#r "C:\Users\Drew\Desktop\Projects\Dev\MJ Proc Gen\MJ Proc Gen\bin\Debug\netstandard2.0\MJ_Proc_Gen.dll"
using System.Linq;
using System.Collections;
using System.Collections.Generic;
using System.Drawing;

using Rhino;
using Rhino.Geometry;

using Grasshopper;
using Grasshopper.Kernel;
using Grasshopper.Kernel.Data;
using Grasshopper.Kernel.Types;

using MJ_Proc_Gen;
#endregion

public class Script_Instance : GH_ScriptInstance
{
    private void RunScript(
	object _enableDebug,
	object _refresh,
	ref object debug,
	ref object main)
    {
        bool ed = (bool)_enableDebug;
        MJ_Main m = new MJ_Main(ed);
        debug = m.debug.DebugText;
        main = m;
    }
}
# ---------- end initiate_mj_main ----------
frame = Slider(6630, range=1..10000)
mj_space = CSharpScript(
    main=initiate_mj_main.main,
    name="testspace",
    sizeX=Slider(20, range=1..100),
    sizeY=Slider(20, range=1..100),
    sizeZ=Slider(10, range=1..100),
    defaultState="O")  # -> space
# ---------- mj_space: C# ----------
// Grasshopper Script Instance
#region Usings
using System;
#r "C:\Users\Drew\Desktop\Projects\Dev\MJ Proc Gen\MJ Proc Gen\bin\Debug\netstandard2.0\MJ_Proc_Gen.dll"
using System.Linq;
using System.Collections;
using System.Collections.Generic;
using System.Drawing;

using Rhino;
using Rhino.Geometry;

using Grasshopper;
using Grasshopper.Kernel;
using Grasshopper.Kernel.Data;
using Grasshopper.Kernel.Types;

using MJ_Proc_Gen;
#endregion

public class Script_Instance : GH_ScriptInstance
{
    private void RunScript(
	object _main,
	object _name,
	object _sizeX,
	object _sizeY,
	object _sizeZ,
	object _defaultState,
	ref object space)
    {
        string name = (string)_name;
        int x = Convert.ToInt32(_sizeX);
        int y = Convert.ToInt32(_sizeY);
        int z = Convert.ToInt32(_sizeZ);
        string defaultState = (string)_defaultState;
        MJ_Main main = (MJ_Main)_main;
        Space s = new Space(name, x, y, z, defaultState, main);
        space = s;
    }
}
# ---------- end mj_space ----------
add_spaces_and_rules = CSharpScript(main=initiate_mj_main.main, spaces=mj_space, rulesets=panel)  # -> debug, main; inputs spaces: list, rulesets: list
# ---------- add_spaces_and_rules: C# ----------
// Grasshopper Script Instance
#region Usings
using System;
#r "C:\Users\Drew\Desktop\Projects\Dev\MJ Proc Gen\MJ Proc Gen\bin\Debug\netstandard2.0\MJ_Proc_Gen.dll"
using System.Linq;
using System.Collections;
using System.Collections.Generic;
using System.Drawing;

using Rhino;
using Rhino.Geometry;

using Grasshopper;
using Grasshopper.Kernel;
using Grasshopper.Kernel.Data;
using Grasshopper.Kernel.Types;

using MJ_Proc_Gen;
#endregion

public class Script_Instance : GH_ScriptInstance
{
    private void RunScript(
	object _main,
	List<object> _spaces,
	List<object> _rulesets,
	ref object debug,
	ref object main)
    {
        MJ_Main m = (MJ_Main) _main;
        foreach (Space s in _spaces)
        {
            m.AddSpace(s);
        }
        foreach (string path in _rulesets)
        {
            m.AddRuleSet(path);
        }
        main = m;
        debug = m.debug.DebugText;
    }
}
# ---------- end add_spaces_and_rules ----------
panel_2 = Panel(initiate_mj_main.debug)
refresh_2 = Button()
panel_3 = Panel(add_spaces_and_rules.debug)
runmj = CSharpScript(
    main=add_spaces_and_rules.main,
    space="testspace",
    ruleset="testrules",
    maxOperations=Slider(10, range=0..1000000),
    seed=Slider(-517694, range=-1000000..1000000),
    refresh=refresh_2)  # -> debug, main
# ---------- runmj: C# ----------
// Grasshopper Script Instance
#region Usings
using System;
#r "C:\Users\Drew\Desktop\Projects\Dev\MJ Proc Gen\MJ Proc Gen\bin\Debug\netstandard2.0\MJ_Proc_Gen.dll"
using System.Linq;
using System.Collections;
using System.Collections.Generic;
using System.Drawing;

using Rhino;
using Rhino.Geometry;

using Grasshopper;
using Grasshopper.Kernel;
using Grasshopper.Kernel.Data;
using Grasshopper.Kernel.Types;

using MJ_Proc_Gen;
#endregion

public class Script_Instance : GH_ScriptInstance
{
    private void RunScript(
	object _main,
	object _space,
	object _ruleset,
	object _maxOperations,
	object _seed,
	object _refresh,
	ref object debug,
	ref object main)
    {
        MJ_Main m = (MJ_Main) _main;
        string space = (string)_space;
        string ruleset = (string)_ruleset;
        int maxOps = Convert.ToInt32(_maxOperations);
        int seed = Convert.ToInt32(_seed);
        m.RunMJ(space, ruleset, maxOps, seed);
        main = m;
        debug = m.debug.DebugText;
    }
}
# ---------- end runmj ----------
subtraction = Subtraction(A=frame, B=1)
output_state_frames = CSharpScript(main=runmj.main, space="testspace", frame=subtraction)  # -> totalFrames, frame
# ---------- output_state_frames: C# ----------
// Grasshopper Script Instance
#region Usings
using System;
#r "C:\Users\Drew\Desktop\Projects\Dev\MJ Proc Gen\MJ Proc Gen\bin\Debug\netstandard2.0\MJ_Proc_Gen.dll"
using System.Linq;
using System.Collections;
using System.Collections.Generic;
using System.Drawing;

using Rhino;
using Rhino.Geometry;

using Grasshopper;
using Grasshopper.Kernel;
using Grasshopper.Kernel.Data;
using Grasshopper.Kernel.Types;

using MJ_Proc_Gen;
#endregion

public class Script_Instance : GH_ScriptInstance
{
    private void RunScript(
	object _main,
	object _space,
	object _frame,
	ref object totalFrames,
	ref object frame)
    {
        MJ_Main m = (MJ_Main)_main;
        int f = Convert.ToInt32(_frame);
        string s = (string)_space;
        string[] frameStrings = m.Spaces[s].SpaceStateOutput.Split('&');
        string[] planes = frameStrings[f].Split('/');
        frame = planes;
        totalFrames = frameStrings.Length;
    }
}
# ---------- end output_state_frames ----------
panel_4 = Panel(output_state_frames.frame)
panel_5 = Panel(output_state_frames.totalFrames)
panel_6 = Panel(runmj.debug)
